# Grasshopper definition Script.gh (Grasshopper 1.0.7)
# plug-ins: DIVA Daylight

# ---- group: Simulation
brep = Brep(<brep referenced from the Rhino model>)
brep_2 = Brep([<brep referenced from the Rhino model> x5])
grid = DaylightingGrid(
    Geometry=brep,
    Spacing=Slider(2, range=0..10),
    BooleanValue_0=False,
    BooleanValue_1=False,
    BooleanValue_10=False,
    BooleanValue_11=False,
    BooleanValue_12=False,
    BooleanValue_13=False,
    BooleanValue_14=False,
    BooleanValue_15=False,
    BooleanValue_16=False,
    BooleanValue_17=False,
    BooleanValue_18=False,
    BooleanValue_19=False,
    BooleanValue_2=False,
    BooleanValue_20=False,
    BooleanValue_21=False,
    BooleanValue_22=False,
    BooleanValue_3=False,
    BooleanValue_4=False,
    BooleanValue_5=False,
    BooleanValue_6=False,
    BooleanValue_7=False,
    BooleanValue_8=False,
    BooleanValue_9=False,
    Color_0=RGBA(0, 0, 0, 0),
    Color_1=RGBA(0, 0, 0, 0),
    Color_10=RGBA(0, 0, 0, 0),
    Color_11=RGBA(0, 0, 0, 0),
    Color_12=RGBA(0, 0, 0, 0),
    Color_13=RGBA(0, 0, 0, 0),
    Color_14=RGBA(0, 0, 0, 0)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)
obj = SceneObject(
    Geometry=brep,
    BooleanValue_0=False,
    BooleanValue_1=False,
    Color_0=RGBA(0, 0, 0, 0),
    Color_1=RGBA(0, 0, 0, 0),
    Hidden_0=False,
    Hidden_1=False,
    IntegerValue_0=-2147483648,
    IntegerValue_1=-2147483648,
    IntervalMax_0=-1.797693135e+308,
    IntervalMax_1=-1.797693135e+308,
    IntervalMin_0=-1.797693135e+308,
    IntervalMin_1=-1.797693135e+308,
    Name_0="Geometry",
    Name_1="Material",
    NumberValue_0=-1.797693135e+308,
    NumberValue_1=-1.797693135e+308,
    OutputHidden_0=False,
    OutputName_0="Scene Object",
    TextValuePersistent_1="GenericOpaqueWhite_50",
    TextValueVolatile_1="GenericOpaqueWhite_50")
obj_2 = SceneObject(
    Geometry=brep_2,
    BooleanValue_0=False,
    BooleanValue_1=False,
    Color_0=RGBA(0, 0, 0, 0),
    Color_1=RGBA(0, 0, 0, 0),
    Hidden_0=False,
    Hidden_1=False,
    IntegerValue_0=-2147483648,
    IntegerValue_1=-2147483648,
    IntervalMax_0=-1.797693135e+308,
    IntervalMax_1=-1.797693135e+308,
    IntervalMin_0=-1.797693135e+308,
    IntervalMin_1=-1.797693135e+308,
    Name_0="Geometry",
    Name_1="Material",
    NumberValue_0=-1.797693135e+308,
    NumberValue_1=-1.797693135e+308,
    OutputHidden_0=False,
    OutputName_0="Scene Object",
    TextValuePersistent_1="GenericOpaqueWhite_50",
    TextValueVolatile_1="GenericOpaqueWhite_50")
rad_map = RadiationMap(
    Name="myObj",
    Grids=grid,
    Objects=[obj, obj_2],
    RhinoScene=False,
    Run=Button(),
    BooleanValue_0=False,
    BooleanValue_1=False,
    BooleanValue_10=False,
    BooleanValue_11=False,
    BooleanValue_12=False,
    BooleanValue_13=False,
    BooleanValue_14=False,
    BooleanValue_15=False,
    BooleanValue_16=False,
    BooleanValue_17=False,
    BooleanValue_18=False,
    BooleanValue_19=False,
    BooleanValue_2=False,
    BooleanValue_3=False,
    BooleanValue_4=False,
    BooleanValue_5=False,
    BooleanValue_6=False,
    BooleanValue_7=False,
    BooleanValue_8=False,
    BooleanValue_9=False,
    Color_0=RGBA(0, 0, 0, 0),
    Color_1=RGBA(0, 0, 0, 0),
    Color_10=RGBA(0, 0, 0, 0),
    Color_11=RGBA(0, 0, 0, 0),
    Color_12=RGBA(0, 0, 0, 0),
    Color_13=RGBA(0, 0, 0, 0),
    Color_14=RGBA(0, 0, 0, 0),
    Color_15=RGBA(0, 0, 0, 0),
    Color_16=RGBA(0, 0, 0, 0),
    Color_17=RGBA(0, 0, 0, 0)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)  # -> Out, SolarEnergy, EnergyDensity, Grid
grid_v = GridViewer(
    Grid=rad_map.Grid,
    BooleanValue_0=False,
    BooleanValue_1=False,
    BooleanValue_10=False,
    BooleanValue_11=False,
    BooleanValue_12=False,
    BooleanValue_13=False,
    BooleanValue_14=False,
    BooleanValue_15=False,
    BooleanValue_16=False,
    BooleanValue_17=False,
    BooleanValue_18=False,
    BooleanValue_19=False,
    BooleanValue_2=False,
    BooleanValue_20=False,
    BooleanValue_3=False,
    BooleanValue_4=False,
    BooleanValue_5=False,
    BooleanValue_6=False,
    BooleanValue_7=False,
    BooleanValue_8=False,
    BooleanValue_9=False,
    Color_0=RGBA(0, 0, 0, 0),
    Color_1=RGBA(0, 0, 0, 0),
    Color_10=RGBA(0, 0, 0, 0),
    Color_11=RGBA(0, 0, 0, 0),
    Color_12=RGBA(0, 0, 0, 0),
    Color_13=RGBA(0, 0, 0, 0),
    Color_14=RGBA(0, 0, 0, 0),
    Color_15=RGBA(0, 0, 0, 0),
    Color_16=RGBA(0, 0, 0, 0)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)  # -> SensorPts, SensorData

# ---- group: Sunpath
# Harvard GSD J-term class :
# Intro to data science and buildign performance simulation.
# This .gh file is created by Ellie Jungmin Han.
# __author__ = "elliehan07"
# __version__ = "2021.1.11"
number_slider = Slider(100, range=0..100)
sun_path = SunPath(
    CenterPoint=Point(0, 0, 0),
    Radius=number_slider,
    Month=1,
    Day=1,
    Hour=12,
    BooleanValue_0=False,
    BooleanValue_1=False,
    BooleanValue_2=False,
    BooleanValue_3=False,
    BooleanValue_4=False,
    BooleanValue_5=False,
    BooleanValue_6=False,
    BooleanValue_7=False,
    BooleanValue_8=False,
    BooleanValue_9=False,
    Color_0=RGBA(0, 0, 0, 0),
    Color_1=RGBA(0, 0, 0, 0),
    Color_2=RGBA(0, 0, 0, 0),
    Color_3=RGBA(0, 0, 0, 0),
    Color_4=RGBA(0, 0, 0, 0),
    Color_5=RGBA(0, 0, 0, 0),
    Color_6=RGBA(0, 0, 0, 0),
    Color_7=RGBA(0, 0, 0, 0),
    Color_8=RGBA(0, 0, 0, 0),
    Color_9=RGBA(0, 0, 0, 0),
    Hidden_0=False,
    Hidden_1=True,
    Hidden_2=True,
    Hidden_3=True,
    Hidden_4=True,
    Hidden_5=False,
    Hidden_6=False,
    Hidden_7=False,
    Hidden_8=False,
    Hidden_9=False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)  # -> SolarVector, Azimuth, Altitude

# ---- group: myPythonCode
path = FilePath("C:\Users\ellie\Dropbox\E_Work\Jterm\Day2\myFile.txt")
myfile_reader = MyFileReader(INPUT=path)  # -> out, a, b
# ---------- myfile_reader: Python ----------
__author__ = "ellie"
__version__ = "2021.1.11"

import rhinoscriptsyntax as rs
import scriptcontext as sc
import json
import Rhino as r

ghenv.Component.Name = "myFileReader"
ghenv.Component.NickName = 'MyFile-Reader'

def OpenCSV(fn): # function for opening a txt file.
    file = open(fn, 'r')
    lines = file.readlines()
    file.close()
    return lines

d = OpenCSV(INPUT)

pts = []
values = []

for i, d in enumerate(d): # loop through lines
    if(i != 0):
        # Write your code here
        """
        # Call your lines with variables
        
        
        
        # creates a points list
        
        
        # creates a value list
        
        
        """

a= pts
b= values
# ---------- end myfile_reader ----------
myfile_writer = MyFileWriter(write=Toggle(True))  # -> out, a; inputs points: list, values: list
# ---------- myfile_writer: Python ----------
__author__ = "ellie"
__version__ = "2021.1.11"

import rhinoscriptsyntax as rs
import json
import Rhino as r
import os

ghenv.Component.Name = "myFileWriter"
ghenv.Component.NickName = 'MyFile-Writer'

gh_path = ghdoc.Path # Get GH document's file path
file_name = "myFile.txt" # Create text file name
dir = os.path.dirname(os.path.realpath(gh_path))
file = os.path.join(dir, file_name) # Create text file path
filePath = open(file, "w") # Open text file to create it

if write:
    filePath = open(file, "w") # Open the file
    for i, point in enumerate(points): # Iterate through lines
        # Write your code here
        """
        # Store your lines to variables
        
        
        # Write separate lines
        
        """
    filePath.close() # Close the file
else:
    msg = "Set 'write' to True."
    ghenv.Component.AddRuntimeMessage(gh.Kernel.GH_RuntimeMessageLevel.Warning, msg)
# ---------- end myfile_writer ----------
pt = Point(myfile_reader.a)

# ---- group: Visualization
data = Data()
bnd = Bounds(Numbers=data)
dedomain = DeconstructDomain(Domain=bnd)  # -> Start, End
gradient = Gradient(
    LowerLimit=dedomain.End,
    UpperLimit=dedomain.Start,
    Parameter=data,
    stops=[0: RGB(234, 38, 0), 0.25: RGB(234, 126, 0), 0.5: RGB(254, 244, 84), 0.75: RGB(173, 203, 249), 1: RGB(75, 107, 169)])
pt_2 = Point(pt)
cloud = CloudDisplay(Points=pt_2, Colours=gradient, Size=Slider(1, range=0..1), SpriteType=0)
