# Grasshopper definition PV.gh (Grasshopper 1.0.7)
# plug-ins: umiPVGR, Archsim

# ---- group: Set PVs array / buildings
brep = Brep(<brep referenced from the Rhino model>)

# ---- group: Set PVs array
ur = UrbanRoof(ListOfBreps=brep, TiltedAngle=30)  # -> UrbanBuildings, UrbanRoofs
number_slider = Slider(1, range=0..1)
number_slider_2 = Slider(10, range=0..10)
# Harvard GSD J-term class :
# Intro to data science and buildign performance simulation.
# This .gh file is created by Ellie Jungmin Han.
# __author__ = "elliehan07"
# __version__ = "2021.1.12"
number_slider_3 = Slider(1, range=0..1)
pvarray = PVOptimization(
    HostSurface=ur.UrbanRoofs,
    DoubleForWidth=number_slider,
    DoubleForLength=number_slider,
    DoubleForRotation=0,
    BoolForOptimization=False)  # -> Point3dOfCenter, RectangleForCell, SurfaceForCell
brep_2 = Brep(ur.UrbanRoofs)
multiplication = Multiplication(A="-3", B=number_slider_3)
component_guid = CSharpScript(
    input=number_slider_3,
    TooltipDescriptionOverride="Displays the GUID for Grasshopper Canvas Components Useful for RhinoScript/PythonScript Automation",
    TooltipTextOverride="Gets the GUID of a Grasshopper Component")  # -> out, GUID
# ---------- component_guid: C# ----------
    List<Guid> guids = new List<Guid>();
    foreach (Grasshopper.Kernel.IGH_Param param in Component.Params.Input)
    {
      foreach(IGH_Param source in param.Sources)
      {
        guids.Add(source.InstanceGuid);
      }
    }

    GUID = guids;
# ---------- end component_guid ----------
vec = VectorXYZ(XComponent=0, YComponent="0.5", ZComponent=multiplication)  # -> Vector, Length
panel = Panel(component_guid.GUID)
pvarray_2 = PVAngle(CellRectangle=pvarray.RectangleForCell, SolarVector=vec.Vector, ProjectedLength=number_slider)
pv = TakesSurfacesGeneratesPVPanels(
    BrepSurfaces=pvarray.SurfaceForCell,
    EfficiencyFraction=Slider(0.25, range=0..1),
    EffectiveAreaFraction=Slider(0.99, range=0..1))

# ---- group: Set PVs array / create panels
Z = UnitZ(Factor=Slider(0.863, range=0..10))
move = Move(Geometry=brep_2, Motion=Z)  # -> Geometry, Transform

# ----
brep_3 = Brep(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)

# ---- group: Run PV simulation
pv_2 = RunsAPVSimulation(
    PVPanels=pv,
    Breps=brep_3,
    ProjectName="umi-demo",
    WorkingDirectory="c:/tmp/PV",
    WeatherFilePath="USA_MA_Boston-Logan.Intl.AP.725090_TMY3",
    StartsTheSimulation=Toggle(True),
    settings="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")  # -> flatten(Model), CSV
load_csv = LoadResultFile(Model=pv_2.Model, Normalize=False, Toggle=Toggle(True))  # -> PanelGeometry, flatten(PanelCentroid), flatten(Results), Labels
division = Division(A=load_csv.Results, B="3600000")
panel_2 = Panel(load_csv.Results)
ma = MassAddition(Input=flatten(load_csv.Results))  # -> flatten(Result), PartialResults
division_2 = Division(A=ma.Result, B=panel_2)
generated_kwh = Panel(division_2)

# ---- group: Save your file
myfile_writer = MyFileWriter(myName=number_slider_3, points=load_csv.PanelCentroid, values=load_csv.Results, write=Toggle(True))  # -> out, a; inputs points: list, values: list
# ---------- myfile_writer: Python ----------
__author__ = "ellie"
__version__ = "2021.1.11"

import rhinoscriptsyntax as rs
import json
import Rhino as r
import os


ghenv.Component.Name = "myFileWriter"
ghenv.Component.NickName = 'MyFile-Writer'

gh_path = ghdoc.Path # Get GH document's file path
file_name = myName + ".txt" # Create text file name
dir = os.path.dirname(os.path.realpath(gh_path))
file = os.path.join(dir, file_name) # Create text file path
filePath = open(file, "w") # Open text file to create it

if write:
    filePath = open(file, "w") # Open the file
    for i, point in enumerate(points): # Iterate through lines
        my = point.split(",")
        x = str(my[0])
        y = str(my[1])
        z = str(my[2])
        val = str(values[i])
        filePath.write(x + ","+ y+"," + z +","+ val + "\n") # Write separate lines
    filePath.close() # Close the file
else:
    msg = "Set 'write' to True."
    ghenv.Component.AddRuntimeMessage(gh.Kernel.GH_RuntimeMessageLevel.Warning, msg)
# ---------- end myfile_writer ----------
