# Grasshopper definition Zones.gh (Grasshopper 1.0.7)
# plug-ins: Archsim

# ----
# Harvard GSD J-term class :
# Intro to data science and buildign performance simulation.
# This .gh file is created by Ellie Jungmin Han.
# __author__ = "elliehan07"
# __version__ = "2021.1.12"
brep = Brep(<brep referenced from the Rhino model>)
window = Brep(<brep referenced from the Rhino model>)
zone = ThermalZone(
    ThermalZoneGeometry=brep,
    Name="zone",
    SettingsAsFormatedString="-NoSelection-",
    Library="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",
    Settings="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")  # -> ThermalZones, SettingsAsFormatedString
window_2 = Window(
    WindowGeometry=window,
    Library="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",
    Settings="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")  # -> Window, SettingsAsFormatedString
networker = ZoneConnectivityNetwork(ThermalZoneCollection=zone.ThermalZones, Windows=window_2.Window)
run_e = SimulationEngine(
    ThermalModel=networker,
    ProjectName="test",
    WorkingDirectory="C:\Users\ellie\Dropbox\Harvard_Spring_2018\CFD_TA\ArchSim",
    WeatherFile="USA_MA_Boston-Logan.Intl.AP.725090_TMY3",
    StartsTheSimulation=Button(),
    settings="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")  # -> ThermalModel, SettingsAsFormatedString
surfaceanalysis = SurfaceAnalysis(ThermalModel=networker)  # -> Facade, Partition, Ceiling, Roof, ExternalFloor, Floor, Window, FaceID, IDLocation
brep_2 = Brep(surfaceanalysis.Window)
results = LoadResultFile(ThermalModel=run_e.ThermalModel, Toggle=Toggle(True), settings="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")  # -> Results, Labels
panel = Panel(results.Results)

brep_3 = Brep(<brep referenced from the Rhino model>)
brep_4 = Brep([<brep referenced from the Rhino model> x4])
window_3 = Brep([<brep referenced from the Rhino model> x4])
zone_2 = ThermalZone(
    ThermalZoneGeometry=brep_3,
    Name="zone_core",
    SettingsAsFormatedString="-NoSelection-",
    Library="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",
    Settings="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")  # -> ThermalZones, SettingsAsFormatedString
zone_3 = ThermalZone(
    ThermalZoneGeometry=brep_4,
    Name="zone_peri",
    SettingsAsFormatedString="-NoSelection-",
    Library="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",
    Settings="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")  # -> ThermalZones, SettingsAsFormatedString
window_4 = Window(
    WindowGeometry=window_3,
    Library="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",
    Settings="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")  # -> Window, SettingsAsFormatedString
networker_2 = ZoneConnectivityNetwork(ThermalZoneCollection=[zone_3.ThermalZones, zone_2.ThermalZones], Windows=window_4.Window)
run_e_2 = SimulationEngine(
    ThermalModel=networker_2,
    ProjectName="test_2",
    WorkingDirectory="C:\Users\ellie\Dropbox\Harvard_Spring_2018\CFD_TA\ArchSim",
    WeatherFile="USA_MA_Boston-Logan.Intl.AP.725090_TMY3",
    StartsTheSimulation=Button(),
    settings="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")  # -> ThermalModel, SettingsAsFormatedString
surfaceanalysis_2 = SurfaceAnalysis(ThermalModel=networker_2)  # -> Facade, Partition, Ceiling, Roof, ExternalFloor, Floor, Window, FaceID, IDLocation
brep_5 = Brep(surfaceanalysis_2.Roof)
results_2 = LoadResultFile(ThermalModel=run_e_2.ThermalModel, Toggle=Toggle(True), settings="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")  # -> Results, Labels

load_zone_results = LoadZoneResults(ThermalModel=run_e_2.ThermalModel, Toggle=Toggle(True), settings="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")  # -> flatten(ZoneGeometry), ResultsPerZone, Labels, Guid, Name

# ---- group: J to kWh
division = Division(A=load_zone_results.ResultsPerZone, B="3600000")

# ----
ma = MassAddition(Input=load_zone_results.ResultsPerZone)  # -> Result, PartialResults

bnd = Bounds(Numbers=flatten(ma.Result))
dedomain = DeconstructDomain(Domain=bnd)  # -> Start, End
gradient = Gradient(
    LowerLimit=dedomain.Start,
    UpperLimit=dedomain.End,
    Parameter=flatten(ma.Result),
    stops=[0: RGB(75, 107, 169), 0.327: RGB(173, 203, 249), 0.543: RGB(254, 244, 84), 0.788: RGB(234, 126, 0), 1: RGB(234, 38, 0)])
panel_2 = Panel(division)
preview = CustomPreview(Geometry=flatten(load_zone_results.ZoneGeometry), Shader=gradient)

panel_3 = Panel(ma.Result)
